# Grasshopper definition test.gh (Grasshopper 1.0.8)
# plug-ins: RhinoCodePluginGH, Heteroptera, Pufferfish, Park Design Space Planner, Groundhog, Weaverbird, NGon_RH8

mesh = Mesh(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)
quad_remesh_settings = QuadRemeshSettings(
    TargetCount=Slider(10000, range=0..10000),
    AdaptiveSize=0,
    AdaptiveCount=False,
    HardEdges=False,
    SeamEdges=0,
    Symmetry=0,
    GuideCurves=0)
# Easting  ≈ 311,000 m
# Northing ≈ 2,775,000 m
# Elevation = 16
construct_point = ConstructPoint(
    XCoordinate=Slider(311000, range=0..1000000),
    YCoordinate=Slider(2775000, range=0..10000000),
    ZCoordinate=Slider(16, range=0..100))
quad_remesh = QuadRemesh(Geometry=mesh, Settings=quad_remesh_settings)
curve = Curve(<curve referenced from the Rhino model>)
point = Point(Point(357.2859512, 283.3398584, 0))
vector_2pt = Vector2Pt(PointA=point, PointB=construct_point, Unitize=False)  # -> Vector, Length
mesh_edges = MeshEdges(Mesh=quad_remesh)  # -> AllE, NakedE
move = Move(Geometry=curve, Motion=vector_2pt.Vector)  # -> Geometry, Transform
move_2 = Move(Geometry=mesh, Motion=vector_2pt.Vector)  # -> Geometry, Transform
plotboundary = Data(move.Geometry)
panel = Panel("C:\Users\shyle\Downloads\al_safa_2_park_design_package_test7")
mesh_2 = Mesh()
run = Data(Toggle(True))
data = Data()
design_package = Data()
design_package_2 = Data(panel)
trigger = Trigger(Interval=10, TimerInterval=10, Target=python_3_script)  # disabled
python_3_script = Python3Script(reset=Button())  # -> out, a
# ---------- python_3_script: Python ----------
import time
import scriptcontext as sc

key = "gh_timer_start"

# Reset or initialize
if reset or key not in sc.sticky:
    sc.sticky[key] = time.perf_counter()

elapsed = time.perf_counter() - sc.sticky[key]

# Integer output
a = int(elapsed)
# ---------- end python_3_script ----------
timer = Panel(python_3_script.a)
plotboundary_2 = Data(plotboundary)
design_package_3 = Data(design_package_2)
run_2 = Data(run)
run_3 = Data(run)
run_4 = Data(run)
design_package_4 = Data(design_package)
run_5 = Data(run)
distribute_park_spaces = DistributeParkSpaces(
    Boundary=plotboundary_2,
    DesignPackage=design_package_3,
    Seed=Slider(3, range=0..10),
    Run=run_2,
    AllPrograms=True,
    Strategy="AUTO",
    UsePackageBoundary=run_3,
    Reseed=False,
    FastPreview=run_4)  # -> Bubbles, Centers, Names, Warnings, Summary, Nodes, NodeNames, Routes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
area = Area(Geometry=plotboundary_2)  # -> Area, Centroid
evaluate_access_combination = EvaluateAccessCombination(DesignPackage=design_package_4, MainIndex=0, SecondaryIndex=1, ServiceIndex=2, Run=run_5)  # -> MainPoint, SecondaryPoint, ServicePoint, SelectedIDs, Valid, HardViolations, CombinedPopulation, AdditionalPopulation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
number_slider = Slider(2, range=0..10)
point_2 = Point(evaluate_access_combination.ServicePoint)
curve_2 = Curve(distribute_park_spaces.Bubbles)
curve_3 = Curve(distribute_park_spaces.ResolvedBoundary)
trigger_2 = Trigger(Interval=10, TimerInterval=10, Target=python_3_script_2)  # disabled
number_slider_2 = Slider(1000, range=0..1000)

# ---- group: Base Mesh
# Example 2 (Right)
mesh_3 = Mesh(<mesh referenced from the Rhino model>)

# ----
bake_park_planning_geometry = BakeParkPlanningGeometry(
    CleanGeometry=distribute_park_spaces.CleanGeometry,
    GeometryNames=distribute_park_spaces.CleanGeometryNames,
    LayerPaths=distribute_park_spaces.CleanGeometryLayers,
    Bake=Button(),
    ReplacePrevious=True)  # -> ObjectIDs, LayerPaths, Summary

total_flow_volume_total = Slider(1000, range=100..1000)
proximity_threshold = Slider(20, range=0..200)
flow_step_size = Slider(81, range=0..100)
grid_divisions = Slider(31, range=0..100)

curve_4 = Curve(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)
area_2 = Area(Geometry=curve_4)  # -> Area, Centroid
number_slider_3 = Slider(45, range=0..100)
number_slider_4 = Slider(15, range=0..100)

flow_step_size_2 = Slider(2, range=0..100)
# Example 2 (Center)
random_points_count = Slider(1000, range=0..1000)
flow_step_limit = Slider(1, range=0..100)
multithread = BooleanToggle(True)

mesh_4 = Mesh(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)
curve_5 = Curve(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)
point_3 = Point(<point referenced from the Rhino model>)
mesh_5 = Mesh(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)
mesh_slope = MeshSlope(Mesh=mesh_5)  # -> MeshFaces, FaceCenters, FaceVectors, FaceSlopes, FaceSlopes_2, FaceSlopes_3
scale = Scale(Geometry=curve_4, Center=area_2.Centroid, Factor=Slider(1.5, range=0..10))  # -> Geometry, Transform
python_3_script_2 = Python3Script(reset=Button())  # -> out, a; same code as python_3_script
voronoi = Voronoi(Points=distribute_park_spaces.Centers, Boundary=distribute_park_spaces.ResolvedBoundary, BruteForceOverride=False)
populate_2d = Populate2D(Region=scale.Geometry, Count=Slider(1000, range=0..10000), Seed=1)

# ---- group: Base Mesh
mesh_6 = Mesh(<mesh referenced from the Rhino model>)

# ----
min_max = MinMax(Number=mesh_slope.FaceSlopes_2)  # -> Minimum, Maximum
proximity_threshold_2 = Slider(58, range=0..200)
panel_2 = Panel(python_3_script_2.a)

# ---- group: Distribute points randomly on mesh for path starts
cluster = Cluster(C=mesh_5, N=random_points_count)

# ----
gradient = Gradient(
    LowerLimit=min_max.Minimum,
    UpperLimit=min_max.Maximum,
    Parameter=mesh_slope.FaceSlopes_2,
    stops=[0: RGB(0, 128, 0), 0.5: RGB(255, 255, 0), 1: RGB(255, 0, 0)])
mesh_color_by_face = MeshColorByFace(Mesh=mesh_5, Colors=gradient)
area_3 = Area(Geometry=distribute_park_spaces.Bubbles)  # -> Area, Centroid
panel_3 = Panel(area.Area)

# ---- group: Calculate the flow paths (for mesh)
flow_projection_mesh = FlowSimulationMesh(Mesh=mesh_5, Points=populate_2d, Fidelity=flow_step_size_2, Steps=python_3_script_2.a, Thread=multithread)  # -> FlowPoints, FlowPaths

# ----
contour_clipper = ContourClipper(ContourCurves=mesh_5)  # -> Contours, EdgedContours, PlanarSurfaces
number_slider_5 = Slider(2, range=0..10)
curve_6 = Curve(flow_projection_mesh.FlowPaths)

# ---- group: Calculate catchment bounds
flow_catchments = FlowCatchments(FlowPaths=flow_projection_mesh.FlowPaths, ProximityThreshold=proximity_threshold)  # -> Catchments, FlowPaths, ColorCodes, Volumes

# ----
boolean_toggle = BooleanToggle(True)
point_4 = Point(<point referenced from the Rhino model>)
point_5 = Point(<point referenced from the Rhino model>)
pooling_color = ColourSwatch(SwatchColor=RGB(255, 255, 255))
number_slider_6 = Slider(2, range=0..10)
colours = Data(flow_catchments.ColorCodes)
flow_paths = Curve(flow_catchments.FlowPaths)

# ---- group: Find average endpoint within a catchment
flow_paths_2 = Curve(flow_catchments.FlowPaths)
end_points = EndPoints(Curve=flow_paths_2)  # -> Start, End
deconstruct = Deconstruct(Point=end_points.End)  # -> XComponent, YComponent, ZComponent
mass_addition = MassAddition(Input=deconstruct.YComponent)  # -> Result, PartialResults
mass_addition_2 = MassAddition(Input=deconstruct.XComponent)  # -> Result, PartialResults
list_length = ListLength(List=deconstruct.XComponent)
mass_addition_3 = MassAddition(Input=deconstruct.ZComponent)  # -> Result, PartialResults
division = Division(A=mass_addition_3.Result, B=list_length)
division_2 = Division(A=mass_addition_2.Result, B=list_length)
division_3 = Division(A=mass_addition.Result, B=list_length)
construct_point_2 = ConstructPoint(XCoordinate=division_2, YCoordinate=division_3, ZCoordinate=division)

# ---- group: Label each catchment center by the volume of water collected
colours_2 = Data(flow_catchments.ColorCodes)
flow_volumes = Number(flow_catchments.Volumes)
flow_volumes_total = Number(total_flow_volume_total)
multiplication = Multiplication(A=flow_volumes, B=flow_volumes_total)
round = Round(Number=multiplication)  # -> Nearest, Floor, Ceiling
concatenate = Concatenate(FragmentA=round.Nearest, FragmentB=" litres")
label_szie = Slider(5, range=0..100)
label_color = ColourSwatch(SwatchColor=RGB(255, 255, 255))
text_tag_3d = TextTag3D(Location=construct_point_2, Text=concatenate, Size=label_szie, Colour=label_color, Justification=7)
custom_preview = CustomPreview(Geometry=construct_point_2, Material=colours_2)

# ----
catchments = Data(flow_catchments.Catchments)
custom_preview_2 = CustomPreview(Geometry=flow_projection_mesh.FlowPaths, Shader=pooling_color)
number_slider_7 = Slider(0, range=0..100)
area_4 = Area(Geometry=distribute_park_spaces.ResolvedBoundary)  # -> Area, Centroid
mesh_7 = Mesh(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)
curve_7 = Curve(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)
vector_2pt_2 = Vector2Pt(PointA=area.Centroid, PointB=area_4.Centroid, Unitize=False)  # -> Vector, Length
move_3 = Move(Geometry=move_2.Geometry, Motion=vector_2pt_2.Vector)  # -> Geometry, Transform
curve_8 = Curve(distribute_park_spaces.RouteCorridorEdges)
number_slider_8 = Slider(0.6, range=0..1)
weaverbird_s_loop_subdivision = WeaverbirdsLoopSubdivision(MeshCurves=move_3.Geometry, Level=Slider(2, range=0..10), SmoothNakedEdges=1)
c_script = CSharpScript(
    Centroids=area_3.Centroid,
    Areas=area_3.Area,
    Boundary=distribute_park_spaces.ResolvedBoundary,
    MinAspect=Slider(1, range=0..1),
    Seed=Slider(9, range=0..10))  # -> out, Cells, CellCenters, ActualAreas, TargetAreas, AreaError, Displacement, LocalPlane; inputs Centroids: list of Point3d, Areas: list of Double, Boundary: Curve, MinAspect: Double, Seed: Int32
# ---------- c_script: C# ----------
#region Usings
using System;
using System.Linq;
using System.Collections;
using System.Collections.Generic;
using System.Drawing;

using Rhino;
using Rhino.Geometry;

using Grasshopper;
using Grasshopper.Kernel;
using Grasshopper.Kernel.Data;
using Grasshopper.Kernel.Types;
#endregion

public class Script_Instance : GH_ScriptInstance
{
    // ============================================================
    // ROTATED + SEEDED SPATIAL RECTANGULAR CARTOGRAM / TREEMAP
    //
    // INPUTS
    // ------------------------------------------------------------
    // Centroids : List<Point3d>
    // Areas     : List<double>
    // Boundary  : Curve
    // MinAspect : double
    // Seed      : int
    //
    // OUTPUTS
    // ------------------------------------------------------------
    // Cells
    // CellCenters
    // ActualAreas
    // TargetAreas
    // AreaError
    // Displacement
    // LocalPlane
    //
    // ============================================================


    // ============================================================
    // ITEM
    // ============================================================

    private class Item
    {
        public int Index;

        public Point3d OriginalPoint;
        public Point3d LocalPoint;

        public double OriginalArea;
        public double ScaledArea;

        public Rect Rectangle;


        public Item(
            int index,
            Point3d originalPoint,
            Point3d localPoint,
            double area)
        {
            Index = index;

            OriginalPoint = originalPoint;
            LocalPoint = localPoint;

            OriginalArea = area;
            ScaledArea = area;
        }
    }


    // ============================================================
    // LOCAL RECTANGLE
    // ============================================================

    private class Rect
    {
        public double X;
        public double Y;

        public double W;
        public double H;


        public Rect(
            double x,
            double y,
            double w,
            double h)
        {
            X = x;
            Y = y;

            W = w;
            H = h;
        }


        public double Area
        {
            get
            {
                return W * H;
            }
        }


        public Point3d Center
        {
            get
            {
                return new Point3d(
                    X + W * 0.5,
                    Y + H * 0.5,
                    0);
            }
        }
    }


    // ============================================================
    // MAIN
    // ============================================================

    private void RunScript(
		List<Point3d> Centroids,
		List<double> Areas,
		Curve Boundary,
		double MinAspect,
		int Seed,
		ref object Cells,
		ref object CellCenters,
		ref object ActualAreas,
		ref object TargetAreas,
		ref object AreaError,
		ref object Displacement,
		ref object LocalPlane)
    {
        // ========================================================
        // VALIDATE
        // ========================================================

        if (Centroids == null ||
            Centroids.Count == 0)
        {
            Print(
                "No centroids supplied.");

            return;
        }


        if (Areas == null ||
            Areas.Count == 0)
        {
            Print(
                "No areas supplied.");

            return;
        }


        if (Boundary == null ||
            !Boundary.IsClosed)
        {
            Print(
                "Boundary must be a closed curve.");

            return;
        }


        int n =
            Math.Min(
                Centroids.Count,
                Areas.Count);


        if (MinAspect <= 0)
            MinAspect = 0.15;


        MinAspect =
            Math.Max(
                0.02,
                Math.Min(
                    1.0,
                    MinAspect));


        double tolerance =
            RhinoDocument != null
            ? RhinoDocument.ModelAbsoluteTolerance
            : 0.001;


        Random random =
            new Random(
                Seed);


        // ========================================================
        // CREATE SITE-ALIGNED PLANE
        //
        // Longest boundary edge = Local X-axis.
        // ========================================================

        Plane sitePlane;


        if (!CreateBoundaryPlane(
            Boundary,
            tolerance,
            out sitePlane))
        {
            Print(
                "Could not determine site orientation.");

            return;
        }


        // ========================================================
        // TRANSFORMS
        // ========================================================

        Transform worldToLocal =
            Transform.PlaneToPlane(
                sitePlane,
                Plane.WorldXY);


        Transform localToWorld =
            Transform.PlaneToPlane(
                Plane.WorldXY,
                sitePlane);


        // ========================================================
        // TRANSFORM BOUNDARY INTO LOCAL XY
        // ========================================================

        Curve localBoundary =
            Boundary.DuplicateCurve();


        localBoundary.Transform(
            worldToLocal);


        BoundingBox bb =
            localBoundary.GetBoundingBox(
                true);


        double parkWidth =
            bb.Max.X -
            bb.Min.X;


        double parkHeight =
            bb.Max.Y -
            bb.Min.Y;


        if (parkWidth <= tolerance ||
            parkHeight <= tolerance)
        {
            Print(
                "Invalid boundary dimensions.");

            return;
        }


        Rect park =
            new Rect(
                bb.Min.X,
                bb.Min.Y,
                parkWidth,
                parkHeight);


        // ========================================================
        // CREATE ITEMS IN LOCAL COORDINATES
        // ========================================================

        List<Item> items =
            new List<Item>();


        double totalRequestedArea =
            0;


        for (int i = 0;
             i < n;
             i++)
        {
            double area =
                Math.Max(
                    Areas[i],
                    0.0001);


            Point3d localPoint =
                Centroids[i];


            localPoint.Transform(
                worldToLocal);


            Item item =
                new Item(
                    i,
                    Centroids[i],
                    localPoint,
                    area);


            items.Add(
                item);


            totalRequestedArea +=
                area;
        }


        if (totalRequestedArea <=
            0.0001)
        {
            Print(
                "Total program area is invalid.");

            return;
        }


        // ========================================================
        // SCALE PROGRAM AREAS TO PARK RECTANGLE
        // ========================================================

        double parkArea =
            park.Area;


        double scale =
            parkArea /
            totalRequestedArea;


        foreach (
            Item item
            in items)
        {
            item.ScaledArea =
                item.OriginalArea *
                scale;
        }


        // ========================================================
        // SOLVE SEEDED SPATIAL TREEMAP
        // ========================================================

        SolveSpatialTreemap(
            items,
            park,
            MinAspect,
            random);


        // ========================================================
        // RETURN TO ORIGINAL ORDER
        // ========================================================

        items =
            items
            .OrderBy(
                x => x.Index)
            .ToList();


        // ========================================================
        // OUTPUT CONTAINERS
        // ========================================================

        List<Curve> outputCells =
            new List<Curve>();


        List<Point3d> outputCenters =
            new List<Point3d>();


        List<double> actualAreas =
            new List<double>();


        List<double> targetAreas =
            new List<double>();


        List<double> areaErrors =
            new List<double>();


        List<double> displacements =
            new List<double>();


        // ========================================================
        // CREATE WORLD-SPACE OUTPUT
        // ========================================================

        foreach (
            Item item
            in items)
        {
            Rect r =
                item.Rectangle;


            // ----------------------------------------------------
            // Cell curve in local XY
            // ----------------------------------------------------

            Curve cell =
                RectToCurve(
                    r);


            // ----------------------------------------------------
            // Transform back into boundary orientation
            // ----------------------------------------------------

            cell.Transform(
                localToWorld);


            outputCells.Add(
                cell);


            // ----------------------------------------------------
            // Center
            // ----------------------------------------------------

            Point3d center =
                r.Center;


            center.Transform(
                localToWorld);


            outputCenters.Add(
                center);


            // ----------------------------------------------------
            // Area
            // ----------------------------------------------------

            double actualArea =
                r.Area;


            actualAreas.Add(
                actualArea);


            targetAreas.Add(
                item.ScaledArea);


            double error =
                Math.Abs(
                    actualArea -
                    item.ScaledArea)
                /
                Math.Max(
                    item.ScaledArea,
                    0.0001)
                *
                100.0;


            areaErrors.Add(
                error);


            // ----------------------------------------------------
            // Distance to original centroid
            // ----------------------------------------------------

            double displacement =
                center.DistanceTo(
                    item.OriginalPoint);


            displacements.Add(
                displacement);
        }


        // ========================================================
        // ASSIGN OUTPUTS
        // ========================================================

        Cells =
            outputCells;


        CellCenters =
            outputCenters;


        ActualAreas =
            actualAreas;


        TargetAreas =
            targetAreas;


        AreaError =
            areaErrors;


        Displacement =
            displacements;


        LocalPlane =
            sitePlane;


        // ========================================================
        // REPORT
        // ========================================================

        Print(
            "Rotated seeded spatial treemap generated.");


        Print(
            "Seed: {0}",
            Seed);


        Print(
            "Park Area: {0:0.00}",
            parkArea);


        Print(
            "Requested Program Area: {0:0.00}",
            totalRequestedArea);


        Print(
            "Scale Factor: {0:0.000}",
            scale);


        Print(
            "Local Width: {0:0.00}",
            parkWidth);


        Print(
            "Local Height: {0:0.00}",
            parkHeight);


        Print(
            "Programs: {0}",
            n);
    }


    // ============================================================
    // RECURSIVE SEEDED SPATIAL TREEMAP
    // ============================================================

    private void SolveSpatialTreemap(
        List<Item> items,
        Rect rect,
        double minAspect,
        Random random)
    {
        // ========================================================
        // VALIDATE
        // ========================================================

        if (items == null ||
            items.Count == 0)
        {
            return;
        }


        // ========================================================
        // BASE CASE
        // ========================================================

        if (items.Count == 1)
        {
            items[0].Rectangle =
                rect;

            return;
        }


        // ========================================================
        // LOCAL CENTROID DISTRIBUTION
        // ========================================================

        double minPX =
            items.Min(
                i =>
                i.LocalPoint.X);


        double maxPX =
            items.Max(
                i =>
                i.LocalPoint.X);


        double minPY =
            items.Min(
                i =>
                i.LocalPoint.Y);


        double maxPY =
            items.Max(
                i =>
                i.LocalPoint.Y);


        double spreadX =
            maxPX -
            minPX;


        double spreadY =
            maxPY -
            minPY;


        // ========================================================
        // CHOOSE SPLIT DIRECTION
        //
        // Strong centroid signal:
        // preserve centroid direction.
        //
        // Ambiguous distribution:
        // use seeded variation.
        // ========================================================

        bool splitVertical;


        double minSpread =
            Math.Min(
                spreadX,
                spreadY);


        double maxSpread =
            Math.Max(
                spreadX,
                spreadY);


        double directionRatio;


        if (minSpread <
            0.0001)
        {
            directionRatio =
                maxSpread > 0
                ? Double.MaxValue
                : 1.0;
        }
        else
        {
            directionRatio =
                maxSpread /
                minSpread;
        }


        // --------------------------------------------------------
        // Strong directional preference
        // --------------------------------------------------------

        if (directionRatio >
            1.35)
        {
            splitVertical =
                spreadX >
                spreadY;
        }

        else
        {
            // ----------------------------------------------------
            // Seed controls ambiguous cases.
            //
            // Rectangle shape provides probability bias.
            // Wide rect -> higher chance vertical split.
            // Tall rect -> higher chance horizontal split.
            // ----------------------------------------------------

            double rectangleBias =
                rect.W /
                Math.Max(
                    rect.W +
                    rect.H,
                    0.0001);


            double randomValue =
                random.NextDouble();


            splitVertical =
                randomValue <
                rectangleBias;
        }


        // ========================================================
        // SORT CENTROIDS IN LOCAL SPACE
        // ========================================================

        List<Item> sorted;


        if (splitVertical)
        {
            sorted =
                items
                .OrderBy(
                    i =>
                    i.LocalPoint.X)
                .ThenBy(
                    i =>
                    i.LocalPoint.Y)
                .ToList();
        }

        else
        {
            sorted =
                items
                .OrderBy(
                    i =>
                    i.LocalPoint.Y)
                .ThenBy(
                    i =>
                    i.LocalPoint.X)
                .ToList();
        }


        // ========================================================
        // CALCULATE AREA BALANCE
        // ========================================================

        double totalArea =
            sorted.Sum(
                i =>
                i.ScaledArea);


        double halfArea =
            totalArea *
            0.5;


        double cumulative =
            0;


        double bestDifference =
            Double.MaxValue;


        // ========================================================
        // FIND OPTIMAL AREA SPLIT DIFFERENCE
        // ========================================================

        for (int i = 1;
             i < sorted.Count;
             i++)
        {
            cumulative +=
                sorted[
                    i - 1]
                .ScaledArea;


            double difference =
                Math.Abs(
                    cumulative -
                    halfArea);


            if (difference <
                bestDifference)
            {
                bestDifference =
                    difference;
            }
        }


        // ========================================================
        // COLLECT NEAR-OPTIMAL SPLITS
        //
        // Seed selects among these alternatives.
        // ========================================================

        List<int> possibleSplits =
            new List<int>();


        cumulative =
            0;


        double splitTolerance =
            totalArea *
            0.15;


        for (int i = 1;
             i < sorted.Count;
             i++)
        {
            cumulative +=
                sorted[
                    i - 1]
                .ScaledArea;


            double difference =
                Math.Abs(
                    cumulative -
                    halfArea);


            if (difference <=
                bestDifference +
                splitTolerance)
            {
                possibleSplits.Add(
                    i);
            }
        }


        // ========================================================
        // SEEDED SPLIT INDEX
        // ========================================================

        int splitIndex;


        if (possibleSplits.Count >
            0)
        {
            int randomIndex =
                random.Next(
                    possibleSplits.Count);


            splitIndex =
                possibleSplits[
                    randomIndex];
        }

        else
        {
            splitIndex =
                Math.Max(
                    1,
                    sorted.Count /
                    2);
        }


        // ========================================================
        // CREATE GROUPS
        // ========================================================

        List<Item> groupA =
            sorted
            .Take(
                splitIndex)
            .ToList();


        List<Item> groupB =
            sorted
            .Skip(
                splitIndex)
            .ToList();


        // Safety
        if (groupA.Count == 0 ||
            groupB.Count == 0)
        {
            splitIndex =
                Math.Max(
                    1,
                    sorted.Count /
                    2);


            groupA =
                sorted
                .Take(
                    splitIndex)
                .ToList();


            groupB =
                sorted
                .Skip(
                    splitIndex)
                .ToList();
        }


        // ========================================================
        // GROUP AREAS
        // ========================================================

        double areaA =
            groupA.Sum(
                i =>
                i.ScaledArea);


        double areaB =
            groupB.Sum(
                i =>
                i.ScaledArea);


        double ratio =
            areaA /
            Math.Max(
                areaA +
                areaB,
                0.0001);


        // ========================================================
        // PREVENT EXTREME RATIOS
        //
        // Normally unnecessary, but avoids numerical disaster.
        // ========================================================

        ratio =
            Math.Max(
                0.0001,
                Math.Min(
                    0.9999,
                    ratio));


        // ========================================================
        // ASPECT RATIO QUALITY TEST
        //
        // Seed variation is allowed,
        // but poor geometry can override it.
        // ========================================================

        if (splitVertical)
        {
            double widthA =
                rect.W *
                ratio;


            double widthB =
                rect.W -
                widthA;


            double aspectA =
                AspectRatio(
                    widthA,
                    rect.H);


            double aspectB =
                AspectRatio(
                    widthB,
                    rect.H);


            double currentQuality =
                Math.Min(
                    aspectA,
                    aspectB);


            if (currentQuality <
                minAspect)
            {
                // ------------------------------------------------
                // Test alternative horizontal split
                // ------------------------------------------------

                double heightA =
                    rect.H *
                    ratio;


                double heightB =
                    rect.H -
                    heightA;


                double altA =
                    AspectRatio(
                        rect.W,
                        heightA);


                double altB =
                    AspectRatio(
                        rect.W,
                        heightB);


                double alternativeQuality =
                    Math.Min(
                        altA,
                        altB);


                if (alternativeQuality >
                    currentQuality)
                {
                    splitVertical =
                        false;
                }
            }
        }

        else
        {
            double heightA =
                rect.H *
                ratio;


            double heightB =
                rect.H -
                heightA;


            double aspectA =
                AspectRatio(
                    rect.W,
                    heightA);


            double aspectB =
                AspectRatio(
                    rect.W,
                    heightB);


            double currentQuality =
                Math.Min(
                    aspectA,
                    aspectB);


            if (currentQuality <
                minAspect)
            {
                // ------------------------------------------------
                // Test alternative vertical split
                // ------------------------------------------------

                double widthA =
                    rect.W *
                    ratio;


                double widthB =
                    rect.W -
                    widthA;


                double altA =
                    AspectRatio(
                        widthA,
                        rect.H);


                double altB =
                    AspectRatio(
                        widthB,
                        rect.H);


                double alternativeQuality =
                    Math.Min(
                        altA,
                        altB);


                if (alternativeQuality >
                    currentQuality)
                {
                    splitVertical =
                        true;
                }
            }
        }


        // ========================================================
        // CREATE CHILD RECTANGLES
        // ========================================================

        Rect rectA;
        Rect rectB;


        if (splitVertical)
        {
            // ----------------------------------------------------
            // LEFT / RIGHT
            // ----------------------------------------------------

            double widthA =
                rect.W *
                ratio;


            double widthB =
                rect.W -
                widthA;


            rectA =
                new Rect(
                    rect.X,
                    rect.Y,
                    widthA,
                    rect.H);


            rectB =
                new Rect(
                    rect.X +
                    widthA,
                    rect.Y,
                    widthB,
                    rect.H);
        }

        else
        {
            // ----------------------------------------------------
            // BOTTOM / TOP
            // ----------------------------------------------------

            double heightA =
                rect.H *
                ratio;


            double heightB =
                rect.H -
                heightA;


            rectA =
                new Rect(
                    rect.X,
                    rect.Y,
                    rect.W,
                    heightA);


            rectB =
                new Rect(
                    rect.X,
                    rect.Y +
                    heightA,
                    rect.W,
                    heightB);
        }


        // ========================================================
        // RECURSE
        //
        // SAME RANDOM GENERATOR:
        // deterministic for the same seed.
        // ========================================================

        SolveSpatialTreemap(
            groupA,
            rectA,
            minAspect,
            random);


        SolveSpatialTreemap(
            groupB,
            rectB,
            minAspect,
            random);
    }


    // ============================================================
    // CREATE SITE PLANE FROM BOUNDARY
    //
    // Uses longest straight boundary edge.
    //
    // ============================================================

    private bool CreateBoundaryPlane(
        Curve boundary,
        double tolerance,
        out Plane plane)
    {
        plane =
            Plane.WorldXY;


        Polyline polyline;


        // ========================================================
        // BEST CASE: POLYLINE
        // ========================================================

        if (boundary.TryGetPolyline(
            out polyline))
        {
            if (polyline.Count <
                2)
            {
                return false;
            }


            double longest =
                0;


            Vector3d bestDirection =
                Vector3d.XAxis;


            for (int i = 0;
                 i <
                 polyline.Count - 1;
                 i++)
            {
                Vector3d direction =
                    polyline[
                        i + 1]
                    -
                    polyline[i];


                // Treemap is planar
                direction.Z =
                    0;


                double length =
                    direction.Length;


                if (length >
                    longest)
                {
                    longest =
                        length;


                    bestDirection =
                        direction;
                }
            }


            if (bestDirection.Length <=
                tolerance)
            {
                return false;
            }


            if (!bestDirection.Unitize())
            {
                return false;
            }


            Vector3d yAxis =
                new Vector3d(
                    -bestDirection.Y,
                    bestDirection.X,
                    0);


            if (!yAxis.Unitize())
            {
                return false;
            }


            Point3d center =
                GetBoundaryCentroid(
                    boundary);


            plane =
                new Plane(
                    center,
                    bestDirection,
                    yAxis);


            return
                plane.IsValid;
        }


        // ========================================================
        // FALLBACK:
        // SAMPLE CURVE SEGMENTS
        // ========================================================

        int samples =
            200;


        double bestLength =
            0;


        Vector3d best =
            Vector3d.XAxis;


        Point3d previous =
            boundary.PointAtStart;


        for (int i = 1;
             i <= samples;
             i++)
        {
            double normalized =
                (double)i /
                samples;


            double parameter =
                boundary.Domain.ParameterAt(
                    normalized);


            Point3d current =
                boundary.PointAt(
                    parameter);


            Vector3d direction =
                current -
                previous;


            direction.Z =
                0;


            double length =
                direction.Length;


            if (length >
                bestLength)
            {
                bestLength =
                    length;


                best =
                    direction;
            }


            previous =
                current;
        }


        if (best.Length <=
            tolerance)
        {
            return false;
        }


        if (!best.Unitize())
        {
            return false;
        }


        Vector3d perpendicular =
            new Vector3d(
                -best.Y,
                best.X,
                0);


        if (!perpendicular.Unitize())
        {
            return false;
        }


        plane =
            new Plane(
                GetBoundaryCentroid(
                    boundary),
                best,
                perpendicular);


        return
            plane.IsValid;
    }


    // ============================================================
    // BOUNDARY CENTROID
    // ============================================================

    private Point3d GetBoundaryCentroid(
        Curve boundary)
    {
        AreaMassProperties amp =
            AreaMassProperties.Compute(
                boundary);


        if (amp != null)
        {
            Point3d centroid =
                amp.Centroid;


            amp.Dispose();


            return centroid;
        }


        return
            boundary
            .GetBoundingBox(
                true)
            .Center;
    }


    // ============================================================
    // RECTANGLE -> CURVE
    // ============================================================

    private Curve RectToCurve(
        Rect rect)
    {
        Polyline polyline =
            new Polyline();


        polyline.Add(
            new Point3d(
                rect.X,
                rect.Y,
                0));


        polyline.Add(
            new Point3d(
                rect.X +
                rect.W,
                rect.Y,
                0));


        polyline.Add(
            new Point3d(
                rect.X +
                rect.W,
                rect.Y +
                rect.H,
                0));


        polyline.Add(
            new Point3d(
                rect.X,
                rect.Y +
                rect.H,
                0));


        polyline.Add(
            new Point3d(
                rect.X,
                rect.Y,
                0));


        return
            polyline
            .ToNurbsCurve();
    }


    // ============================================================
    // ASPECT RATIO
    //
    // 1.0 = square
    // 0.5 = 1:2
    // 0.2 = 1:5
    // ============================================================

    private double AspectRatio(
        double width,
        double height)
    {
        if (width <=
            0 ||
            height <=
            0)
        {
            return 0;
        }


        double min =
            Math.Min(
                width,
                height);


        double max =
            Math.Max(
                width,
                height);


        return
            min /
            max;
    }
}
# ---------- end c_script ----------
treemap_path_network = TreemapPathNetwork(
    Boundary=distribute_park_spaces.ResolvedBoundary,
    Cells=c_script.Cells,
    ProgramIDs=distribute_park_spaces.AreaProgramIDs,
    ProgramNames=distribute_park_spaces.Names,
    MainEntrance=point_5,
    SecondaryEntrance=point_4,
    PrimaryWidth=3,
    SecondaryWidth=2,
    ServiceWidth=4,
    Run=boolean_toggle)  # -> PrimaryPath, SecondaryPaths, ServicePath, Portals, PortalData, CorridorEdges, PathData, Warnings, Summary
curve_9 = Curve(treemap_path_network.CorridorEdges)
boolean_toggle_2 = BooleanToggle(True)
design_package_5 = Data(design_package_2)
mesh_edges_2 = MeshEdges(Mesh=weaverbird_s_loop_subdivision)  # -> AllE, NakedE
tree_edge_path_network = TreeEdgePathNetwork(
    Boundary=distribute_park_spaces.ResolvedBoundary,
    Cells=c_script.Cells,
    ProgramIDs=distribute_park_spaces.AreaProgramIDs,
    ProgramNames=distribute_park_spaces.Names,
    Run=boolean_toggle)  # -> TreeEdgePaths, SharedEdgePortals, SnappedMainEntrance, PortalData, PathData, Warnings, Summary, ClippedCells
point_6 = Point(<point referenced from the Rhino model>)
generate_circulation = GenerateCirculation(
    Boundary=distribute_park_spaces.ResolvedBoundary,
    ProgramPolygons=c_script.Cells,
    ProgramIDs=distribute_park_spaces.AreaProgramIDs,
    MainEntrance=point_6,
    DesignPackage=design_package_5,
    CellSize=2,
    RouteReuse=0.35,
    Run=boolean_toggle_2,
    Smoothness=0.65,
    PolygonMode="AUTO",
    MaximumTerritoryFill=0.75)  # -> PrimaryPaths, SecondaryPaths, TertiaryPaths, ServicePaths, AccessCandidates, SelectedAccess, GraphNodes, BlockedGridCells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
point_7 = Point()
point_8 = Point(<point referenced from the Rhino model>)
curve_10 = Curve(distribute_park_spaces.Routes)
select_baraha_candidates = SelectBarahaCandidates(
    Boundary=distribute_park_spaces.ResolvedBoundary,
    CandidateFootprints=distribute_park_spaces.BarahaCandidateFootprints,
    CandidateData=distribute_park_spaces.BarahaCandidateData,
    MaximumCount=Slider(4, range=0..10),
    Clearance=2,
    Run=boolean_toggle_2)  # -> SelectedFootprints, SelectedCenters, SelectedData, RejectedFootprints, Decisions, Summary
text_tag = TextTag(Location=distribute_park_spaces.Centers, Text=distribute_park_spaces.Names)
number_slider_9 = Slider(0.9, range=0..10)
text_tag_2 = TextTag(Location=c_script.CellCenters, Text=distribute_park_spaces.Names)
curve_11 = Curve(tree_edge_path_network.TreeEdgePaths)

# ---- group: Color code flow paths by catchment
custom_preview_3 = CustomPreview(Geometry=flow_paths, Shader=colours)

# ---- group: Color code catchment boundaries
custom_preview_4 = CustomPreview(Geometry=catchments, Shader=colours)

# ----
negative = Negative(Value=number_slider_9)
text_tag_3 = TextTag()
curve_12 = Curve(distribute_park_spaces.Bubbles)
deconstruct_mesh = DeconstructMesh(Mesh=weaverbird_s_loop_subdivision)  # -> Vertices, Faces, Colours, Normals
generate_dune_terrain = GenerateDuneTerrain(
    ExistingTerrain=weaverbird_s_loop_subdivision,
    Boundary=distribute_park_spaces.ResolvedBoundary,
    DuneAxes=distribute_park_spaces.DuneMorphologyAxes,
    DuneAxisNames=distribute_park_spaces.DuneAxisNames,
    SelectedBarahas=select_baraha_candidates.SelectedFootprints,
    LandscapeRidgeHeight=1.2,
    ArchitecturalRidgeHeight=Slider(8, range=0..10),
    RidgeOffset=Slider(20, range=0..100),
    RidgeHalfWidth=6,
    BarahaBermWidth=6,
    BalanceStrength=1,
    SmoothingPasses=3,
    Run=boolean_toggle_2)  # -> ProposedTerrain, RidgeCrestGuides, ValleyGuides, BarahaClearings, VertexDeltaZ, MaximumCut, MaximumFill, MeanActiveDelta, Summary
offset_curve = OffsetCurve(Curve=curve_11, Plane=PlaneXY(0, 0, 0), Distance=number_slider_9, BothSides=negative, Kinks=0, CapType=1)
deconstruct_mesh_2 = DeconstructMesh(Mesh=generate_dune_terrain.ProposedTerrain)  # -> Vertices, Faces, Colours, Normals
negative_2 = Negative()
distance = Distance(PointA=deconstruct_mesh.Vertices, PointB=deconstruct_mesh_2.Vertices)
mesh_8 = Mesh(generate_dune_terrain.ProposedTerrain)
bounds = Bounds(Numbers=distance)
curve_13 = Curve()
curve_14 = Curve(generate_dune_terrain.BarahaClearings)
curve_15 = Curve(generate_dune_terrain.ValleyGuides)
curve_16 = Curve(generate_dune_terrain.RidgeCrestGuides)
panel_4 = Panel(generate_dune_terrain.Summary)
deconstruct_domain = DeconstructDomain(Domain=bounds)  # -> Start, End
panel_5 = Panel(distance)
gradient_2 = Gradient(
    LowerLimit=deconstruct_domain.Start,
    UpperLimit=deconstruct_domain.End,
    Parameter=distance,
    stops=[0: RGB(48, 18, 59), 0.0294: RGB(56, 40, 112), 0.0588: RGB(63, 62, 156), 0.0882: RGB(68, 82, 193), 0.118: RGB(70, 102, 221), 0.147: RGB(71, 122, 241)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])
estimate_park_cut_fill = EstimateParkCutFill(
    ExistingTerrain=weaverbird_s_loop_subdivision,
    ProposedTerrain=generate_dune_terrain.ProposedTerrain,
    GridSpacing=2,
    Run=boolean_toggle_2)  # -> SamplePoints, DeltaZ, CutVolume, FillVolume, NetVolume, TotalEarthwork, DisturbedArea, MaximumCutDepth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
evaluate_terrain_routes = EvaluateTerrainRoutes(
    TerrainMesh=generate_dune_terrain.ProposedTerrain,
    Routes=distribute_park_spaces.Routes,
    Mode="Walking",
    SampleSpacing=2,
    EnforceMaxSlope=invert(False),
    MaxSlopePercent=Slider(5, range=0..10),
    Run=boolean_toggle_2)  # -> TerrainRoutes, HorizontalLength, TerrainLength, ElevationGain, ElevationLoss, MaximumSlope, AverageSlope, SlopeViolationLength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
custom_preview_5 = CustomPreview(Geometry=deconstruct_mesh_2.Vertices, Material=gradient_2)
panel_6 = Panel(evaluate_terrain_routes.Summary)
curve_17 = Curve(evaluate_terrain_routes.TerrainRoutes)
panel_7 = Panel(estimate_park_cut_fill.Summary)

# ==== cluster Cluster
N = ClusterInput()
C = ClusterInput()
bbox = BoundingBox(Content=C, Plane=PlaneXY(0, 0, 0))  # -> Box, Box_2
debrep = DeconstructBrep(Brep=bbox.Box)  # -> Faces, Edges, Vertices
item = ListItem(List=debrep.Faces, Index=Slider(5, range=0..10), Wrap=True)
pop2d = Populate2D(Region=item, Count=N, Seed=1)
volume = Volume(Geometry=bbox.Box)  # -> Volume, Centroid
area = Area(Geometry=item)  # -> Area, Centroid
vector_2pt = Vector2Pt(PointA=area.Centroid, PointB=volume.Centroid, Unitize=False)  # -> Vector, Length
deconstruct_vector = DeconstructVector(Vector=vector_2pt.Vector)  # -> XComponent, YComponent, ZComponent
unit_z = UnitZ(Factor=deconstruct_vector.ZComponent)
project = ProjectPoint(Point=pop2d, Direction=unit_z, Geometry=C)  # -> Point, Index
P = ClusterOutput(project.Point)
